% Simulink data dictionary configuration_dictionary.sldd

Configuration = Simulink.ConfigSet(StartTime="0", StopTime="inf", FixedStep="1e-3", Solver="FixedStepAuto", ProdHWDeviceType="Intel->x86-64 (Linux 64)", SystemTargetFile="speedgoat.tlc", TargetLang="C++")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
car_wheel_base = Simulink.Parameter(877, Unit="mm")
gearbox_ratio = Simulink.Parameter(40.61)
wheel_diameter = Simulink.Parameter(360, Unit="mm")
tstep = Simulink.Parameter(0.001)